# Dynamo graph 1_connect_to_db.dyn (Dynamo 2.12.1.8246)

# note: pre-deliting table (if its exists)

# group: data columns
code_block = CodeBlock { "Id"; "Идентификатор объекта"; }
code_block_2 = CodeBlock { "Color"; "Цвет объекта"; }

uuid = DynPgsql.Table.Data_type.Uuid()
data_column = DynPgsql.Table.Data_column.Data_column(name=code_block.out0, type=uuid, comment=code_block.out1)
string = DynPgsql.Table.Data_type.String()
data_column_2 = DynPgsql.Table.Data_column.Data_column(name=code_block_2.out0, type=string, comment=code_block_2.out1)

# group (continued): data columns
list_create = List.Create(item0=data_column, item1=data_column_2)

# group: geometry column
code_block_3 = CodeBlock { "Solids_geometry"; ""; 0; }

polyhedralSurface = DynPgsql.Geometry.Generals_Geometry_type.PolyhedralSurface()
geometry_column = DynPgsql.Geometry.Generals_Geometry_column.Geometry_column(name=code_block_3.out0, type=polyhedralSurface, SRID=code_block_3.out2, comment=code_block_3.out1)

# group: Create table (drop las version and create new)
code_block_4 = CodeBlock { "solids_geometry"; "Table with Acad solids geometry"; "Polyhedral"; }
tableDrop = DynPgsql.Commands.Commands.TableDrop(t_name=code_block_4.out0)
table = DynPgsql.Table.Table.Table(t_name=code_block_4.out0, columns=list_create, Geometry_column=geometry_column, t_comment=code_block_4.out1, geom_comment=code_block_4.out2)
tableCreate = DynPgsql.Commands.Commands.TableCreate(table=table)

# group: connection parameters
code_block_5 = CodeBlock { "localhost"; "5432"; "postgres"; "postgres"; "test_dyn_db1"; }
createConnectSettings = DynPgsql.Connect.CreateConnectSettings(host_name=code_block_5.out0, Port=code_block_5.out1, Username=code_block_5.out2, Password=code_block_5.out3, db_name=code_block_5.out4)

# group: Saving single querries to *.sql file and running it with psql.exe
merge_sql_s = List.Create(item0=tableDrop, item1=tableCreate)
saveQuerry = DynPgsql.Connect.SaveQuerry(sql_queries=merge_sql_s)
runQuerry = DynPgsql.Connect.RunQuerry(path_to_sql_file=saveQuerry, conn_config=createConnectSettings)
