# Dynamo graph demo-1_table with points.dyn (Dynamo 2.12.1.8246)

# note: pre-deliting table (if its exists)

# group: connection parameters
code_block = CodeBlock { "localhost"; "5432"; "postgres"; "postgres"; "test_dyn_db1"; }
createConnectSettings = DynPgsql.Connect.CreateConnectSettings(host_name=code_block.out0, Port=code_block.out1, Username=code_block.out2, Password=code_block.out3, db_name=code_block.out4)

# group: data columns
code_block_2 = CodeBlock { "point_name"; "Name of point"; }
string = DynPgsql.Table.Data_type.String()
data_column = DynPgsql.Table.Data_column.Data_column(name=code_block_2.out0, type=string, comment=code_block_2.out1)
list_create = List.Create(item0=data_column)

# group: geometry column
code_block_3 = CodeBlock { "Points_geometry"; ""; 0; }
point = DynPgsql.Geometry.Generals_Geometry_type.Point()
geometry_column = DynPgsql.Geometry.Generals_Geometry_column.Geometry_column(name=code_block_3.out0, type=point, SRID=code_block_3.out2, comment=code_block_3.out1)

# group: Create table (drop las version and create new)
code_block_4 = CodeBlock { "Demo_table_points"; "Demo table with simple points and property"; "3d points"; }
table = DynPgsql.Table.Table.Table(t_name=code_block_4.out0, columns=list_create, Geometry_column=geometry_column, table_comment=code_block_4.out1, geom_comment=code_block_4.out2)
tableDrop = DynPgsql.Commands.TableDrop(Table=table)
tableCreate = DynPgsql.Commands.TableCreate(table=table)

# group: Generate data and append it to table
generate_test_data = Python()  # IronPython2
# ---------- generate_test_data.python (14 lines) ----------
import sys
import clr
clr.AddReference('ProtoGeometry')
from Autodesk.DesignScript.Geometry import Point as _pnt

out_points = list()
out_properties = list()
for i in range (0,50,5):
	for j in range (0,50,5):
		out_points.append(_pnt.ByCoordinates(i,j,0))
		test_property = list()
		test_property.append(["point_" + str(i) + "_" + str(j)])
		out_properties.append(test_property)
OUT = out_points,out_properties
# ----------------------------------------
properties = CodeBlock(a=generate_test_data) { a[1]; }
points = CodeBlock(a=generate_test_data) { a[0]; }
geometry = DynPgsql.Geometry.Geometry.Geometry(point=points)
insertDataToTable = DynPgsql.Commands.InsertDataToTable(Table=table, data_values=properties, Geometry=geometry)
transpose = List.Transpose(lists=insertDataToTable)
code_block_5 = CodeBlock(a=transpose) { a[0]; }

# group: Saving single querries to *.sql file
merge_sql_s = List.Create(item0=tableDrop, item1=tableCreate)
add_insert_statement = List.Join(list0=merge_sql_s, list1=code_block_5)
saveQuerry = DynPgsql.Connect.SaveQuerry(sql_queries=add_insert_statement)
